# Dynamo graph _ARQPWR_Elevações por lista de Ambiente (BR).dyn (Dynamo 2.6.2.15705)
# packages: Data-Shapes 2022.2.103, Rhythm 2022.10.2

string = StringInput("Ambientes")
boolean = BoolSelector(false)
string_2 = StringInput("Selecionar")
string_3 = StringInput("Selecione os ambientes onde deseja criar as elevações")
current = Document.Current()
activeView = Document.ActiveView(document=current)
viewLevel = Custom[ViewLevel](View=activeView)  # package Data-Shapes; gets the level that a view is associated to
all_elements_at_level = ElementsAtLevel(Level=viewLevel)
flatten = List.Flatten(list=all_elements_at_level)
categories = Categories("OST_Rooms")
all_elements_of_category = ElementsOfCategory(Category=categories)
setIntersection = List.SetIntersection(list1=flatten, list2=all_elements_of_category)
string_4 = StringInput("Nome")
getParameterValueByName = Element.GetParameterValueByName(element=setIntersection, parameterName=string_4)
boolean_2 = BoolSelector(true)
listview_data = Custom[Listview Data](InputName=string_3, Keys=getParameterValueByName, Values=setIntersection, ShowElementCount_optionnal=boolean_2)  # package Data-Shapes; Create data for ListView input in UI.MultiInputForm ++ . Check out www.data-shapes.net for more infos.
boolean_3 = BoolSelector(true)
string_5 = StringInput("Cancelar")
multipleinputform = Custom[MultipleInputForm ++](Description_optional=string, Logo_optional=boolean, ButtonText_optional=string_2, Inputs=listview_data, Toggle=boolean_3, CancelButtonText_optional=string_5)  # package Data-Shapes; Create a form with multiple inputs. see www.data-shapes.net for tutorials and infos!
code_block = CodeBlock { "Selecionar"; "Cancelar"; "Modelo de Vista"; "Selecionar o Modelo de Vista"; }
boolean_4 = BoolSelector(false)
element_types = ElementTypes("ViewFamilyType")
all_elements_of_type = ElementsOfType(element_type=element_types)
code_block_2 = CodeBlock { "Nome da família"; }
getParameterValueByName_2 = Element.GetParameterValueByName(element=all_elements_of_type, parameterName=code_block_2)
code_block_3 = CodeBlock { "Elevação"; }
eq = getParameterValueByName_2 == code_block_3
filterByBoolMask = List.FilterByBoolMask(list=all_elements_of_type, mask=eq)
name = Element.Name(element=filterByBoolMask.in)  # graph output
code_block_4 = CodeBlock { [1]; }
dropdown_data = Custom[DropDown Data](InputName=code_block.out3, Keys=name, Values=filterByBoolMask.in, DefaultValueIndex=code_block_4)  # package Data-Shapes; Create data for DropDown input in UI.MultiInputForm ++ . Check out www.data-shapes.net for more infos.
boolean_5 = BoolSelector(true)
multipleinputform_2 = Custom[MultipleInputForm ++](Description_optional=code_block.out2, Logo_optional=boolean_4, ButtonText_optional=code_block.out0, Inputs=dropdown_data, Toggle=boolean_5, CancelButtonText_optional=code_block.out1)

# group: Criar Elevação
location = Room.Location(room=multipleinputform.User_Inputs)
escala_da_vista_1 = DoubleInput(25)  # graph input
ʳʰʸᵗʰᵐ_elevationmarker = Rhythm.Revit.Elements.ElevationMarker.CreateElevationMarker(location=location, scaleFactor=escala_da_vista_1, viewFamilyType=multipleinputform_2.User_Inputs)
current_2 = Document.Current()
activeView_2 = Document.ActiveView(document=current_2)
code_block_5 = CodeBlock { 0..3; }
ʳʰʸᵗʰᵐ_elevationmarker_2 = Rhythm.Revit.Elements.ElevationMarker.CreateElevationByMarkerIndex(elevationMarker=ʳʰʸᵗʰᵐ_elevationmarker, planView=activeView_2, index=code_block_5@L1)
flatten_2 = List.Flatten(list=ʳʰʸᵗʰᵐ_elevationmarker_2@L3)
watch = Watch(location)

# group: Criar Nome por Ambiente
number = Room.Number(room=multipleinputform.User_Inputs)
name_2 = Room.Name(room=multipleinputform.User_Inputs)
code_block_6 = CodeBlock(roomNumb=number, roomName=name_2) { roomNumb + " / " + roomName + " / "; }
flatten_3 = List.Flatten(list=code_block_6)

# group: Usar último caractere no Nome
name_3 = Element.Name(element=flatten_2)
length = String.Length(str=name_3)
code_block_7 = CodeBlock(x=length) { 0; x-1; }
remove = String.Remove(str=name_3, startIndex=code_block_7.out0, count=code_block_7.out1)

# group: Criar Dictionary
code_block_8 = CodeBlock { 1..4; "a".."d"; }
string_from_object = FromObject(obj=code_block_8.out0)
byKeysValues = DesignScript.Builtin.Dictionary.ByKeysValues(keys=code_block_8.out1, values=string_from_object)
valueAtKey = DesignScript.Builtin.Dictionary.ValueAtKey(dictionary=byKeysValues, key=remove)

# group: Nomear vistas e assuntos
code_block_9 = CodeBlock { "Nome da vista"; "Assunto"; }
add = flatten_3 + valueAtKey@L2
setParameterByName = Element.SetParameterByName(element=flatten_2@L2, parameterName=code_block_9.out0, value=add@L2)
code_block_10 = CodeBlock(rmNmb=number, rmNm=name_2) { rmNmb + " / " + rmNm; }
toUpper = String.ToUpper(str=code_block_10)
setParameterByName_2 = Element.SetParameterByName(element=flatten_2@L2, parameterName=code_block_9.out1, value=toUpper@L2, lacing=Longest)
