# Dynamo graph _ARQPWR_Exportar (BR).dyn "_ARQPWR_Exportar 2" (Dynamo 2.6.2.15705)
# packages: bimorphNodes 4.2.1

element_types = ElementTypes("ViewSchedule")
all_elements_of_type = ElementsOfType(element_type=element_types)
name = Element.Name(element=all_elements_of_type)
watch = Watch(name)
code_block = CodeBlock { "7."; true; }
startsWith = String.StartsWith(str=name, searchFor=code_block.out0, ignoreCase=code_block.out1)
filterByBoolMask = List.FilterByBoolMask(list=all_elements_of_type, mask=startsWith)
watch_2 = Watch(filterByBoolMask.in)
remover_cabeçalhos = BoolSelector(true)  # graph input
code_block_2 = CodeBlock { true; false; }
getData = Revit.Schedule.GetData(scheduleView=filterByBoolMask.in, removeHeading=remover_cabeçalhos, refresh=code_block_2.out0)
watch_3 = Watch(getData)
arquivo_do_excel = Filename(".\_ARQPWR_Template - Orçamentação.xlsx")  # graph input
code_block_3 = CodeBlock { "INPUT"; 4; 0; }
code_block_4 = CodeBlock { 1; }
flatten = List.Flatten(list=getData, amt=code_block_4)
watch_4 = Watch(flatten)
code_block_5 = CodeBlock { ","; "."; }
replace = String.Replace(str=watch_4, searchFor=code_block_5.out0, replaceWith=code_block_5.out1)
boolean = BoolSelector(false)
exportExcel = Data.ExportExcel(filePath=arquivo_do_excel, sheetName=code_block_3.out0, startRow=code_block_3.out1, startCol=code_block_3.out2, data=replace, overWrite=boolean)
watch_5 = Watch(exportExcel)
watch_6 = Watch(replace)
