# Dynamo graph _ARQPWR_Limpar modelo (BR) (2.4).dyn "_ARQPWR_Limpar modelo (BR) (2.04)" (Dynamo 2.6.2.15705)
# packages: Clockwork for Dynamo 2.x 2.4.0, Rhythm 2022.10.2

# group: Ambientes / Número
categories = Categories("OST_Rooms")
all_elements_of_category = ElementsOfCategory(Category=categories)
# note: Script Name: _ARQPWR_Limpar modelo (BR) (2.04).dyn
# Packages used in this script:
# Clockwork for Dynamo 2.x 2.4.0
# Rhythm 2022.10.2
# TimeStamp : 2022/11/6 17:3
ambientes_número = BoolSelector(false)  # graph input
code_block = CodeBlock { "Número"; }
string = StringInput("")

ʳʰʸᵗʰᵐ_helpers_toggle = Rhythm.Helpers.Helpers.Toggle(obj=all_elements_of_category, toggle=ambientes_número)

# group (continued): Ambientes / Número
parameters = Element.Parameters(element=ʳʰʸᵗʰᵐ_helpers_toggle)
setParameterByName = Element.SetParameterByName(element=ʳʰʸᵗʰᵐ_helpers_toggle, parameterName=code_block, value=string)

# group: Ambientes / Nome
categories_2 = Categories("OST_Rooms")
all_elements_of_category_2 = ElementsOfCategory(Category=categories_2)
ambientes_nome = BoolSelector(false)  # graph input
code_block_2 = CodeBlock { "Nome"; }
string_2 = StringInput("")

ʳʰʸᵗʰᵐ_helpers_toggle_2 = Rhythm.Helpers.Helpers.Toggle(obj=all_elements_of_category_2, toggle=ambientes_nome)

# group (continued): Ambientes / Nome
parameters_2 = Element.Parameters(element=ʳʰʸᵗʰᵐ_helpers_toggle_2)
setParameterByName_2 = Element.SetParameterByName(element=ʳʰʸᵗʰᵐ_helpers_toggle_2, parameterName=code_block_2, value=string_2)

# group: Ambientes / Departamento
categories_3 = Categories("OST_Rooms")
all_elements_of_category_3 = ElementsOfCategory(Category=categories_3)
ambientes_departamento = BoolSelector(false)  # graph input
code_block_3 = CodeBlock { "Departamento"; }
string_3 = StringInput("")

ʳʰʸᵗʰᵐ_helpers_toggle_3 = Rhythm.Helpers.Helpers.Toggle(obj=all_elements_of_category_3, toggle=ambientes_departamento)

# group (continued): Ambientes / Departamento
parameters_3 = Element.Parameters(element=ʳʰʸᵗʰᵐ_helpers_toggle_3)
setParameterByName_3 = Element.SetParameterByName(element=ʳʰʸᵗʰᵐ_helpers_toggle_3, parameterName=code_block_3, value=string_3)

# group: Portas / Marca
categories_4 = Categories("OST_Doors")
all_elements_of_category_4 = ElementsOfCategory(Category=categories_4)
portas_marca = BoolSelector(false)  # graph input
code_block_4 = CodeBlock { "Marca"; }
string_4 = StringInput("")

ʳʰʸᵗʰᵐ_helpers_toggle_4 = Rhythm.Helpers.Helpers.Toggle(obj=all_elements_of_category_4, toggle=portas_marca)

# group (continued): Portas / Marca
parameters_4 = Element.Parameters(element=ʳʰʸᵗʰᵐ_helpers_toggle_4)
setParameterByName_4 = Element.SetParameterByName(element=ʳʰʸᵗʰᵐ_helpers_toggle_4, parameterName=code_block_4, value=string_4)

# group: Janelas / Marca
categories_5 = Categories("OST_Windows")
all_elements_of_category_5 = ElementsOfCategory(Category=categories_5)
janelas_marca = BoolSelector(false)  # graph input
code_block_5 = CodeBlock { "Marca"; }
string_5 = StringInput("")

ʳʰʸᵗʰᵐ_helpers_toggle_5 = Rhythm.Helpers.Helpers.Toggle(obj=all_elements_of_category_5, toggle=janelas_marca)

# group (continued): Janelas / Marca
parameters_5 = Element.Parameters(element=ʳʰʸᵗʰᵐ_helpers_toggle_5)
setParameterByName_5 = Element.SetParameterByName(element=ʳʰʸᵗʰᵐ_helpers_toggle_5, parameterName=code_block_5, value=string_5)

# group: Paredes / Marca
categories_6 = Categories("OST_Walls")
all_elements_of_category_6 = ElementsOfCategory(Category=categories_6)
paredes_marca = BoolSelector(false)  # graph input
code_block_6 = CodeBlock { "Marca"; }
string_6 = StringInput("")

ʳʰʸᵗʰᵐ_helpers_toggle_6 = Rhythm.Helpers.Helpers.Toggle(obj=all_elements_of_category_6, toggle=paredes_marca)

# group (continued): Paredes / Marca
parameters_6 = Element.Parameters(element=ʳʰʸᵗʰᵐ_helpers_toggle_6)
setParameterByName_6 = Element.SetParameterByName(element=ʳʰʸᵗʰᵐ_helpers_toggle_6, parameterName=code_block_6, value=string_6)

# group: Pisos / Marca
categories_7 = Categories("OST_Floors")
all_elements_of_category_7 = ElementsOfCategory(Category=categories_7)
pisos_marca = BoolSelector(false)  # graph input
code_block_7 = CodeBlock { "Marca"; }
string_7 = StringInput("")

ʳʰʸᵗʰᵐ_helpers_toggle_7 = Rhythm.Helpers.Helpers.Toggle(obj=all_elements_of_category_7, toggle=pisos_marca)

# group (continued): Pisos / Marca
parameters_7 = Element.Parameters(element=ʳʰʸᵗʰᵐ_helpers_toggle_7)
setParameterByName_7 = Element.SetParameterByName(element=ʳʰʸᵗʰᵐ_helpers_toggle_7, parameterName=code_block_7, value=string_7)

# group: Forros / Marca
categories_8 = Categories("OST_Ceilings")
all_elements_of_category_8 = ElementsOfCategory(Category=categories_8)
forros_marca = BoolSelector(false)  # graph input
code_block_8 = CodeBlock { "Marca"; }
string_8 = StringInput("")

ʳʰʸᵗʰᵐ_helpers_toggle_8 = Rhythm.Helpers.Helpers.Toggle(obj=all_elements_of_category_8, toggle=forros_marca)

# group (continued): Forros / Marca
parameters_8 = Element.Parameters(element=ʳʰʸᵗʰᵐ_helpers_toggle_8)
setParameterByName_8 = Element.SetParameterByName(element=ʳʰʸᵗʰᵐ_helpers_toggle_8, parameterName=code_block_8, value=string_8)

# group: Materiais / Marca
categories_9 = Categories("OST_Materials")
all_elements_of_category_9 = ElementsOfCategory(Category=categories_9)
materiais_marca = BoolSelector(false)  # graph input
code_block_9 = CodeBlock { "Marca"; }
string_9 = StringInput("")

ʳʰʸᵗʰᵐ_helpers_toggle_9 = Rhythm.Helpers.Helpers.Toggle(obj=all_elements_of_category_9, toggle=materiais_marca)

# group (continued): Materiais / Marca
parameters_9 = Element.Parameters(element=ʳʰʸᵗʰᵐ_helpers_toggle_9)
setParameterByName_9 = Element.SetParameterByName(element=ʳʰʸᵗʰᵐ_helpers_toggle_9, parameterName=code_block_9, value=string_9)

count = List.Count(list=setParameterByName)
code_block_10 = CodeBlock(Num=count) { frase = Num + " Números de Ambientes apagadas."; }
count_2 = List.Count(list=setParameterByName_2)
code_block_11 = CodeBlock(Num=count_2) { frase = Num + " Nomes de Ambientes apagadas."; }
count_3 = List.Count(list=setParameterByName_3)
code_block_12 = CodeBlock(Num=count_3) { frase = Num + " Departamentos de Ambientes apagadas."; }
count_4 = List.Count(list=setParameterByName_4)
code_block_13 = CodeBlock(Num=count_4) { frase = Num + " Marcas de Portas apagadas."; }

# group: Portas / Marca de tipo
categories_10 = Categories("OST_Doors")
portas_marcas_de_tipo = BoolSelector(false)  # graph input
code_block_14 = CodeBlock { "Marca de tipo"; ""; }

ʳʰʸᵗʰᵐ_helpers_toggle_10 = Rhythm.Helpers.Helpers.Toggle(obj=categories_10, toggle=portas_marcas_de_tipo)

# group (continued): Portas / Marca de tipo
all_family_types_of_category = Custom[All Family Types Of Category](category=ʳʰʸᵗʰᵐ_helpers_toggle_10)  # package Clockwork for Dynamo 2.x; Gets all family types/symbols of a given category in the model.
ʳʰʸᵗʰᵐ_elements = Rhythm.Revit.Elements.Elements.SetParameterByNameTypeOrInstance(element=all_family_types_of_category, parameterName=code_block_14.out0, value=code_block_14.out1)

count_5 = List.Count(list=ʳʰʸᵗʰᵐ_elements)
code_block_15 = CodeBlock(Num=count_5) { frase = Num + " Marcas de tipo de Portas apagadas."; }
count_6 = List.Count(list=setParameterByName_5)
code_block_16 = CodeBlock(Num=count_6) { frase = Num + " Marcas de Janelas apagadas."; }

# group: Janelas / Marca de tipo
categories_11 = Categories("OST_Windows")
janelas_marca_de_tipo = BoolSelector(false)  # graph input
code_block_17 = CodeBlock { "Marca de tipo"; ""; }

ʳʰʸᵗʰᵐ_helpers_toggle_11 = Rhythm.Helpers.Helpers.Toggle(obj=categories_11, toggle=janelas_marca_de_tipo)

# group (continued): Janelas / Marca de tipo
all_family_types_of_category_2 = Custom[All Family Types Of Category](category=ʳʰʸᵗʰᵐ_helpers_toggle_11)
ʳʰʸᵗʰᵐ_elements_2 = Rhythm.Revit.Elements.Elements.SetParameterByNameTypeOrInstance(element=all_family_types_of_category_2, parameterName=code_block_17.out0, value=code_block_17.out1)

count_7 = List.Count(list=ʳʰʸᵗʰᵐ_elements_2)
code_block_18 = CodeBlock(Num=count_7) { frase = Num + " Marcas de tipo de Janelas apagadas."; }
count_8 = List.Count(list=setParameterByName_6)
code_block_19 = CodeBlock(Num=count_8) { frase = Num + " Marcas de Paredes apagadas."; }

# group: Paredes / Marca de tipo
categories_12 = Categories("OST_Walls")
paredes_marca_de_tipo = BoolSelector(false)  # graph input
code_block_20 = CodeBlock { "Marca de tipo"; ""; }

ʳʰʸᵗʰᵐ_helpers_toggle_12 = Rhythm.Helpers.Helpers.Toggle(obj=categories_12, toggle=paredes_marca_de_tipo)

# group (continued): Paredes / Marca de tipo
all_family_types_of_category_3 = Custom[All Family Types Of Category](category=ʳʰʸᵗʰᵐ_helpers_toggle_12)
ʳʰʸᵗʰᵐ_elements_3 = Rhythm.Revit.Elements.Elements.SetParameterByNameTypeOrInstance(element=all_family_types_of_category_3, parameterName=code_block_20.out0, value=code_block_20.out1)

count_9 = List.Count(list=ʳʰʸᵗʰᵐ_elements_3)
code_block_21 = CodeBlock(Num=count_9) { frase = Num + " Marcas de tipo de Paredes apagadas."; }
count_10 = List.Count(list=setParameterByName_7)
code_block_22 = CodeBlock(Num=count_10) { frase = Num + " Marcas de Pisos apagadas."; }

# group: Pisos / Marca de tipo
categories_13 = Categories("OST_Floors")
pisos_marca_de_tipo = BoolSelector(false)  # graph input
code_block_23 = CodeBlock { "Marca de tipo"; ""; }

ʳʰʸᵗʰᵐ_helpers_toggle_13 = Rhythm.Helpers.Helpers.Toggle(obj=categories_13, toggle=pisos_marca_de_tipo)

# group (continued): Pisos / Marca de tipo
all_family_types_of_category_4 = Custom[All Family Types Of Category](category=ʳʰʸᵗʰᵐ_helpers_toggle_13)
ʳʰʸᵗʰᵐ_elements_4 = Rhythm.Revit.Elements.Elements.SetParameterByNameTypeOrInstance(element=all_family_types_of_category_4, parameterName=code_block_23.out0, value=code_block_23.out1)

count_11 = List.Count(list=ʳʰʸᵗʰᵐ_elements_4)
code_block_24 = CodeBlock(Num=count_11) { frase = Num + " Marcas de tipo de Pisos apagadas."; }
count_12 = List.Count(list=setParameterByName_8)
code_block_25 = CodeBlock(Num=count_12) { frase = Num + " Marcas de Forros apagadas."; }

# group: Forros / Marca de tipo
categories_14 = Categories("OST_Ceilings")
forros_marca_de_tipo = BoolSelector(false)  # graph input
code_block_26 = CodeBlock { "Marca de tipo"; ""; }

ʳʰʸᵗʰᵐ_helpers_toggle_14 = Rhythm.Helpers.Helpers.Toggle(obj=categories_14, toggle=forros_marca_de_tipo)

# group (continued): Forros / Marca de tipo
all_family_types_of_category_5 = Custom[All Family Types Of Category](category=ʳʰʸᵗʰᵐ_helpers_toggle_14)
ʳʰʸᵗʰᵐ_elements_5 = Rhythm.Revit.Elements.Elements.SetParameterByNameTypeOrInstance(element=all_family_types_of_category_5, parameterName=code_block_26.out0, value=code_block_26.out1)

count_13 = List.Count(list=ʳʰʸᵗʰᵐ_elements_5)
code_block_27 = CodeBlock(Num=count_13) { frase = Num + " Marcas de tipo de Forros apagadas."; }
count_14 = List.Count(list=setParameterByName_9)
code_block_28 = CodeBlock(Num=count_14) { frase = Num + " Marcas de Materiais apagadas."; }

# group: Purge
current = Document.Current()
limpar_não_utilizados_extremo = BoolSelector(false)  # graph input
limpar_no_modo_extremo = BoolSelector(true)
code_block_29 = CodeBlock { 1; }

ʳʰʸᵗʰᵐ_helpers_toggle_15 = Rhythm.Helpers.Helpers.Toggle(obj=current, toggle=limpar_não_utilizados_extremo)

# group (continued): Purge
purgeUnused = Document.PurgeUnused(document=ʳʰʸᵗʰᵐ_helpers_toggle_15, fullPurge=limpar_no_modo_extremo)
flatten = List.Flatten(list=purgeUnused, amt=code_block_29)
count_15 = List.Count(list=flatten)

code_block_30 = CodeBlock(Num=count_15) { frase = Num + " Elementos apagados do modelo."; }
list_create = List.Create(item0=code_block_10, item1=code_block_11, item2=code_block_12, item3=code_block_13, item4=code_block_15, item5=code_block_16, item6=code_block_18, item7=code_block_19, item8=code_block_21, item9=code_block_22, item10=code_block_24, item11=code_block_25, item12=code_block_27, item13=code_block_28, item14=code_block_30)
resultados = Watch(list_create)  # graph output
