# Dynamo graph _ARQPWR_Numerar elementos (BR).dyn "_ARQPWR_Numerar elementos" (Dynamo 2.6.2.15705)

# group: Coletando geometria, linhas e organizando
selecione_os_elementos_a_serem = DSModelElementsSelection()  # "Selecione os elementos a serem numerados"; 20 picked in the model; graph input
selecione_a_spline = DSModelElementSelection()  # 1 picked in the model; graph input
curve = CurveElement.Curve(curveElement=selecione_a_spline)
getLocation = Element.GetLocation(element=selecione_os_elementos_a_serem)
closestPointTo = Geometry.ClosestPointTo(geometry=getLocation, other=curve)
parameterAtPoint = Curve.ParameterAtPoint(curve=curve, point=closestPointTo)
sortByKey = List.SortByKey(list=selecione_os_elementos_a_serem, keys=parameterAtPoint)

adicionar_0_à_esquerda_em = BoolSelector(false)  # "Adicionar 0 à esquerda em números de 0 a 9"; graph input

# group: Personalizando
nome_do_parâmetro_geralmente_é = StringInput("Marca")  # "Nome do parâmetro (Geralmente é "Marca")"; graph input
prefixo_deixe_em_branco_caso_não = StringInput("")  # "Prefixo (Deixe em branco caso não queira)"; graph input
iniciar_no_número = DoubleInput(1)  # graph input
incremento = DoubleInput(1)  # graph input
count = List.Count(list=sortByKey.sorted_list)
mul = incremento * count
add = iniciar_no_número + mul
range = Range(start=iniciar_no_número, end=add, step=incremento)
string_from_object = FromObject(obj=range)
code_block = CodeBlock(x=range, y=string_from_object)
# ---------- code_block.designscript (3 lines) ----------
x<10?
0+y:
x;
# ----------------------------------------
if_ = If(test=adicionar_0_à_esquerda_em, true=code_block, false=string_from_object)
add_2 = prefixo_deixe_em_branco_caso_não + if_
sufixo_deixe_em_branco_caso_não = StringInput("")  # "Sufixo (Deixe em branco caso não queira)"; graph input
add_3 = add_2 + sufixo_deixe_em_branco_caso_não

# group: Aplicando valores
setParameterByName = Element.SetParameterByName(element=sortByKey.sorted_list, parameterName=nome_do_parâmetro_geralmente_é, value=add_3)
