# Dynamo graph _ARQPWR_Pisos por Ambientes (EN).dyn (Dynamo 2.6.2.15705)
# packages: Data-Shapes 2022.2.103

string = StringInput("Ambientes")
boolean = BoolSelector(false)
string_2 = StringInput("Selecionar")
selecionar_nível = Levels("TÉRREO (N.A.)")  # graph input
all_elements_at_level = ElementsAtLevel(Level=selecionar_nível)
categories = Categories("OST_Rooms")
all_elements_of_category = ElementsOfCategory(Category=categories)
setIntersection = List.SetIntersection(list1=all_elements_at_level, list2=all_elements_of_category)
string_3 = StringInput("Name")
getParameterValueByName = Element.GetParameterValueByName(element=setIntersection, parameterName=string_3)
boolean_2 = BoolSelector(true)
listview_data = Custom[Listview Data](InputName=string, Keys=getParameterValueByName, Values=setIntersection, ShowElementCount_optionnal=boolean_2)  # package Data-Shapes; Create data for ListView input in UI.MultiInputForm ++ . Check out www.data-shapes.net for more infos.
boolean_3 = BoolSelector(true)
string_4 = StringInput("Cancelar")
multipleinputform = Custom[MultipleInputForm ++](Description_optional=string, Logo_optional=boolean, ButtonText_optional=string_2, Inputs=listview_data, Toggle=boolean_3, CancelButtonText_optional=string_4)  # package Data-Shapes; Create a form with multiple inputs. see www.data-shapes.net for tutorials and infos!
finishBoundary = Room.FinishBoundary(room=multipleinputform.User_Inputs)
selecionar_tipo_de_piso = FloorTypes("_ARQPWR_RVS Calçada / Intertravado 8 cm")  # graph input
byOutlineTypeAndLevel = Floor.ByOutlineTypeAndLevel(outlineCurves=finishBoundary, floorType=selecionar_tipo_de_piso, level=selecionar_nível)
