# Dynamo graph _ARQPWR_Revestimentos por Níveis (BR).dyn "_ARQPWR_Criar revestimentos por Ambientes" (Dynamo 2.6.2.15705)
# packages: Data-Shapes 2022.2.103

string = StringInput("Ambientes")
boolean = BoolSelector(false)
string_2 = StringInput("Selecionar")
selecionar_nível_dos_ambientes = Levels("TÉRREO (N.A.)")  # graph input
all_elements_at_level = ElementsAtLevel(Level=selecionar_nível_dos_ambientes)
categories = Categories("OST_Rooms")
all_elements_of_category = ElementsOfCategory(Category=categories)
setIntersection = List.SetIntersection(list1=all_elements_at_level, list2=all_elements_of_category)
string_3 = StringInput("Nome")
getParameterValueByName = Element.GetParameterValueByName(element=setIntersection, parameterName=string_3)
boolean_2 = BoolSelector(true)
listview_data = Custom[Listview Data](InputName=string, Keys=getParameterValueByName, Values=setIntersection, ShowElementCount_optionnal=boolean_2)  # package Data-Shapes; Create data for ListView input in UI.MultiInputForm ++ . Check out www.data-shapes.net for more infos.
boolean_3 = BoolSelector(true)
string_4 = StringInput("Cancelar")
multipleinputform = Custom[MultipleInputForm ++](Description_optional=string, Logo_optional=boolean, ButtonText_optional=string_2, Inputs=listview_data, Toggle=boolean_3, CancelButtonText_optional=string_4)  # package Data-Shapes; Create a form with multiple inputs. see www.data-shapes.net for tutorials and infos!
finishBoundary = Room.FinishBoundary(room=multipleinputform.User_Inputs)
byJoinedCurves = PolyCurve.ByJoinedCurves(curves=finishBoundary)
tipo_de_parede = WallTypes("_ARQPWR_RVS Metro 1")  # graph input
string_5 = StringInput("Largura")
getParameterValueByName_2 = Element.GetParameterValueByName(element=tipo_de_parede, parameterName=string_5)
code_block = CodeBlock(x=getParameterValueByName_2) { -x/2; }
boolean_4 = BoolSelector(false)
offset = PolyCurve.Offset(polyCurve=byJoinedCurves, signedDistance=code_block, extendCircular=boolean_4)
byJoinedCurves_2 = PolyCurve.ByJoinedCurves(curves=offset)
curves = PolyCurve.Curves(polyCurve=byJoinedCurves_2)
nível_de_base = Levels("TÉRREO (N.A.)")  # graph input
nível_de_topo = Levels("TÉRREO (FORRO)")  # graph input
byCurveAndLevels = Wall.ByCurveAndLevels(curve=curves, startLevel=nível_de_base, endLevel=nível_de_topo, wallType=tipo_de_parede)
code_block_2 = CodeBlock { 3; "Linha de localização"; "Delimitação de ambientes"; 0; }
getParameterValueByName_3 = Element.GetParameterValueByName(element=byCurveAndLevels, parameterName=code_block_2.out2)
setParameterByName = Element.SetParameterByName(element=byCurveAndLevels, parameterName=code_block_2.out1, value=code_block_2.out0)
setParameterByName_2 = Element.SetParameterByName(element=byCurveAndLevels, parameterName=code_block_2.out2, value=code_block_2.out3)
