# Dynamo graph _ARQPWR_Santander.dyn (Dynamo 2.6.2.15705)
# packages: bimorphNodes 4.2.1

# group: Filtrar 6.
element_types = ElementTypes("ViewSchedule")
all_elements_of_type = ElementsOfType(element_type=element_types)
name = Element.Name(element=all_elements_of_type)
watch = Watch(name)
code_block = CodeBlock { "6."; true; }
startsWith = String.StartsWith(str=name, searchFor=code_block.out0, ignoreCase=code_block.out1)
filterByBoolMask = List.FilterByBoolMask(list=all_elements_of_type, mask=startsWith)
watch_2 = Watch(filterByBoolMask.in)

name_2 = Element.Name(element=filterByBoolMask.in)
code_block_2 = CodeBlock { "6.4."; true; }
startsWith_2 = String.StartsWith(str=name_2, searchFor=code_block_2.out0, ignoreCase=code_block_2.out1)
filterByBoolMask_2 = List.FilterByBoolMask(list=filterByBoolMask.in, mask=startsWith_2)

# group: Entrada
remover_cabeçalhos = BoolSelector(true)  # graph input
arquivo_do_excel = Filename("C:\Users\andre\OneDrive\Área de Trabalho\4602-001-WKCF-SP-EX-CIV-PC-R00.xlsm")  # graph input

# group: Atualizar Excel / CIVIL
code_block_3 = CodeBlock { true; false; }
getData = Revit.Schedule.GetData(scheduleView=filterByBoolMask_2.out, removeHeading=remover_cabeçalhos, refresh=code_block_3.out0)
watch_3 = Watch(getData)
code_block_4 = CodeBlock { "QUANTITATIVOS"; 12; 1; }
code_block_5 = CodeBlock { 1; }
flatten = List.Flatten(list=getData, amt=code_block_5)
watch_4 = Watch(flatten)
code_block_6 = CodeBlock { ","; "."; }
replace = String.Replace(str=watch_4, searchFor=code_block_6.out0, replaceWith=code_block_6.out1)
boolean = BoolSelector(false)
exportExcel = Data.ExportExcel(filePath=arquivo_do_excel, sheetName=code_block_4.out0, startRow=code_block_4.out1, startCol=code_block_4.out2, data=replace, overWrite=boolean)
watch_5 = Watch(exportExcel)
watch_6 = Watch(replace)

# group: Atualizar Excel / OMISSOS
code_block_7 = CodeBlock { true; false; }
getData_2 = Revit.Schedule.GetData(scheduleView=filterByBoolMask_2.in, removeHeading=remover_cabeçalhos, refresh=code_block_7.out0)
watch_7 = Watch(getData_2)
code_block_8 = CodeBlock { "QUANTITATIVOS"; 12; 6; }
code_block_9 = CodeBlock { 1; }
flatten_2 = List.Flatten(list=getData_2, amt=code_block_9)
watch_8 = Watch(flatten_2)
code_block_10 = CodeBlock { ","; "."; }
replace_2 = String.Replace(str=watch_8, searchFor=code_block_10.out0, replaceWith=code_block_10.out1)
boolean_2 = BoolSelector(false)
exportExcel_2 = Data.ExportExcel(filePath=arquivo_do_excel, sheetName=code_block_8.out0, startRow=code_block_8.out1, startCol=code_block_8.out2, data=replace_2, overWrite=boolean_2)
watch_9 = Watch(exportExcel_2)
watch_10 = Watch(replace_2)
